# Grasshopper definition cluster2.gh (Grasshopper 1.0.8)

P = Plane()
R = Radius()
cir = Circle(Plane=P, Radius=R)
Z = UnitZ(Factor=Slider(10, range=0..10))
extr = Extrude(Base=cir, Direction=Z)
cap = CapHoles(Brep=extr)
B = Brep(cap)
